# Grasshopper definition colours.gh (Grasshopper 1.0.7)

_1 = Slider(0.25, range=0..1)
python = GhPythonScript()  # -> out, points, colours
# ---------- python: Python ----------
print("Hello World")
# ---------- end python ----------
panel = Panel(python.out)
panel_2 = Panel(python.points)
